# Grasshopper definition UMCF_StreetCanyon_Test01.gh (Grasshopper 1.0.8)
# plug-ins: RhinoCodePluginGH, Pufferfish, Eddy3D, UMCF

brep = Brep(<brep referenced from the Rhino model>)
brep_2 = Brep()
mesh = MeshBrep(
    Brep=brep_2,
    Settings={GridMaxCount=0, GridMinCount=16, JaggedSeams=False, MaxEdgeLength=0, MinEdgeLength=0.0001, MinTolerance=0, Refine=True, RefineAngle=0, RelativeTolerance=0.65, SimplePlanes=True, Tolerance=0})
vegregion = VegetationRegion(VegetationMesh=mesh, LAD=Slider(1, range=0..1))
mesh_brep = MeshBrep(
    Brep=brep_2,
    Settings={GridMaxCount=0, GridMinCount=16, JaggedSeams=False, MaxEdgeLength=0, MinEdgeLength=0.0001, MinTolerance=0, Refine=True, RefineAngle=0, RelativeTolerance=0.65, SimplePlanes=True, Tolerance=0})

# ----
# WIND SETTINGS
number_slider = Slider(0, range=0..100)
unit_x = UnitX(Factor=1)
rotate = Rotate(Geometry=unit_x, Angle=degrees(number_slider), Plane=PlaneXY(0, 0, 0))  # -> Geometry, Transform
abl_condition = ABLCondition(WindSpeed=Slider(10, range=0..10), Height=Slider(10, range=0..10), WindDirection=rotate.Geometry)
box_domain_dimensions = BoxDomainDimensions(
    CellSize=Slider(10, range=0..100),
    FrontAdd=Slider(7.6, range=0..100),
    BackAdd=Slider(12.4, range=0..100),
    SidesAdd=Slider(7.6, range=0..100),
    TopAdd=Slider(9, range=0..100),
    RefinementBoxAdd=Slider(2.9, range=0..100))
air_region = AirRegion(ABLConditionSetting=abl_condition, BoxDomainParameters=box_domain_dimensions)
deconstruct_region = DeconstructRegion(Region=air_region)  # -> Name, Type, FileContainers, Setting
list_item = ListItem(List=deconstruct_region.FileContainers, Index=Slider(18, range=0..100), Wrap=True)
deconstruct_filecontainer = DeconstructFileContainer(FileContainer=list_item)  # -> Name, FileType, Keys, Values, RawContent, TotalRawContent
panel = Panel(deconstruct_filecontainer.TotalRawContent)

# ----
# WEATHER
number_slider_2 = Slider(2, range=0..10)
repeat_data = RepeatData(Data="295", Length=number_slider_2)
multiplication = Multiplication(A=Slider(0, range=0..23), B="7200")
integer = Integer(Slider(0, range=0..100))
integer_2 = Integer(multiplication)

# ----
# SETUP
panel_2 = Panel("Buildings")

# ----
# BUILDING
building_material_hamstad5brick = BuildingMaterialHamstad5Brick()
brep_3 = Brep([<brep referenced from the Rhino model> x2])
mesh_brep_2 = MeshBrep(
    Brep=brep_3,
    Settings={GridMaxCount=0, GridMinCount=16, JaggedSeams=False, MaxEdgeLength=0, MinEdgeLength=0.0001, MinTolerance=0, Refine=True, RefineAngle=0, RelativeTolerance=0.65, SimplePlanes=True, Tolerance=0})
solid_region = SolidRegion(SolidRegionName=panel_2, Mesh=mesh_brep_2, Material=building_material_hamstad5brick)

bounding_box = BoundingBox(Content=mesh_brep, Plane=PlaneXY(0, 0, 0))  # -> Box, Box_2; disabled
deconstruct_brep = DeconstructBrep(Brep=bounding_box.Box)  # -> Faces, Edges, Vertices; disabled
point_list = PointList(Points=deconstruct_brep.Vertices)  # disabled
unit_x_2 = UnitX(Factor=1)  # disabled
negative = Negative(Value=unit_x_2)  # disabled
construct_plane = ConstructPlane(Origin=Point(0, 0, 0), XAxis=negative, YAxis=Vector(0, 1, 0))  # disabled
xy_plane = XYPlane(Origin=Point(0, 0, 0))  # disabled
c_script = CSharpScript(x=mesh_brep_2, y=construct_plane)  # -> out, a, b; inputs x: Mesh, y: Plane; disabled
# ---------- c_script: C# ----------
// Grasshopper Script Instance
#region Usings
using System;
using System.Linq;
using System.Collections;
using System.Collections.Generic;
using System.Drawing;

using Rhino;
using Rhino.Geometry;

using Grasshopper;
using Grasshopper.Kernel;
using Grasshopper.Kernel.Data;
using Grasshopper.Kernel.Types;
#endregion

public class Script_Instance : GH_ScriptInstance
{
    #region Notes
    /* 
      Members:
        RhinoDoc RhinoDocument
        GH_Document GrasshopperDocument
        IGH_Component Component
        int Iteration

      Methods (Virtual & overridable):
        Print(string text)
        Print(string format, params object[] args)
        Reflect(object obj)
        Reflect(object obj, string method_name)
    */
    #endregion

    private void RunScript(Mesh x, Plane y, ref object a, ref object b)
    {
        // Write your logic here
        var solidBbox = x.GetBoundingBox(y);
        var outsidePoint = solidBbox.Center;
        outsidePoint.Z = solidBbox.Max.Z + 0.1;
        a = solidBbox;
        b = outsidePoint;
    }
}
# ---------- end c_script ----------

file_path = FilePath("D:\USA_GA_Atlanta-Hartsfield-Jackson.Intl.AP.722190_TMYx.2007-2021\USA_GA_Atlanta-Hartsfield-Jackson.Intl.AP.722190_TMYx.2007-2021.epw")
weather = Weather(EPWFilePath=file_path)
timing_parameters = TimingParameters(Weather=weather, BuildingTemperature=repeat_data, StartDay=integer, StartTime=integer_2, Duration=number_slider_2)

s_vegetation_mesh = Mesh([<mesh referenced from the Rhino model> x8])

# ----
# VEGETATION
number_slider_3 = Slider(5, range=0..10)
number_slider_4 = Slider(0.02, range=0..0.1)
number_slider_5 = Slider(0.455, range=0..1)
number_slider_6 = Slider(1, range=0..1)
vegetation_properties = VegetationProperties()
vegetation_mesh = Mesh([<mesh referenced from the Rhino model> x6])
vegetation_region = VegetationRegion(VegetationMesh=s_vegetation_mesh, LAD=Slider(1, range=0..1), VegetationProperties=vegetation_properties)

# ----
# Reduce Mesh
number_slider_7 = Slider(21, range=0..100)
mesh_2 = Mesh(vegetation_mesh)
reduce_mesh = ReduceMesh(Mesh=mesh_2, FaceCount=number_slider_7, Accuracy=1, FaceType=0, Distort=True, Normalize=False)  # -> Reduced, CountDifference
panel_3 = Panel(reduce_mesh.CountDifference)
mesh_3 = Mesh(reduce_mesh.Reduced)

# ----
# SIMULATION SETTINGS
number_slider_8 = Slider(100, range=0..1000)
simulation_settings = SimulationSettings(NumberOfCPUs=Slider(2, range=0..20), MaxFluidIteration=number_slider_8)
write = Button()
clear = Button()
file_path_2 = FilePath("C:\MetaFoam_Cases\")
urbabmicroclimatefoam_case = UrbabMicroClimateFoamCase(
    WriteCase=write,
    ClearCase=clear,
    NewCaseName="TESTING_05",
    WorkingDirectory=file_path_2,
    AirRegion=air_region,
    VegetationRegions=vegetation_region,
    SolidRegions=solid_region,
    TimingSettings=timing_parameters,
    SimulationSettings=simulation_settings)  # -> ModificationLogs, Case, DomainBox, RefinementBox
case_run = CaseRun(Case=urbabmicroclimatefoam_case.Case, PrepareSimulation=Button(), RunSimulation=Button())  # -> Case, LogFileNames, LogFileContent
deconstruct_case = DeconstructCase(Case=urbabmicroclimatefoam_case.Case)  # -> Name, AirRegion, VegetationRegions, SolidRegions, OpenFOAMInitialConditionDictionaries, OpenFOAMDictionaries, OpenFOAMLists, Scripts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
panel_4 = Panel(urbabmicroclimatefoam_case.ModificationLogs)

deconstruct_region_2 = DeconstructRegion(Region=deconstruct_case.AirRegion)  # -> Name, Type, FileContainers, Setting
deconstruct_region_3 = DeconstructRegion(Region=deconstruct_case.VegetationRegions)  # -> Name, Type, FileContainers, Setting
deconstruct_region_4 = DeconstructRegion(Region=deconstruct_case.SolidRegions)  # -> Name, Type, FileContainers, Setting
list_item_2 = ListItem(List=deconstruct_case.OpenFOAMDictionaries, Index=0, Wrap=True)
panel_5 = Panel(deconstruct_region_3.FileContainers)
panel_6 = Panel(deconstruct_region_4.FileContainers)
deconstruct_filecontainer_2 = DeconstructFileContainer(FileContainer=list_item_2)  # -> Name, FileType, Keys, Values, RawContent, TotalRawContent
list_item_3 = ListItem(List=deconstruct_region_2.FileContainers, Index=Slider(18, range=0..100), Wrap=True)
deconstruct_filecontainer_3 = DeconstructFileContainer(FileContainer=list_item_3)  # -> Name, FileType, Keys, Values, RawContent, TotalRawContent
panel_7 = Panel(deconstruct_filecontainer_2.TotalRawContent)

brep_4 = Brep(brep_3)

# ----
# UTCI
number_slider_9 = Slider(27, range=0..100)
utci = UTCI(
    AmbientTemperature=number_slider_9,
    MeanRadiantTemperature=Slider(19, range=0..100),
    WindVelocity=Slider(7, range=0..10),
    RelativeHumidity=Slider(70, range=0..100))

# ----
# 2. Run Mean Radiant Temperature
# MRT Calc
# 3. Run Universal Thermal
# Climate Index UTCI Calc
button = Button()  # disabled
button_2 = Button()  # disabled
wind_factors = WindFactors(Interpolation=False)  # -> WindFactorsSpatial, WindFactorsAnnual; disabled
mean_radiant_temperature = MeanRadiantTemperature(SimulationMode=0, Run=button)  # disabled
outdoor_thermal_comfort = OutdoorThermalComfort(WindFactorsAnnual=wind_factors.WindFactorsAnnual, MeanRadiantTemperature=mean_radiant_temperature, Run=button_2)  # -> UniversalThermalClimateIndexCObject, ComfortableHours; disabled

number_slider_10 = Slider(246, range=0..1000)
loft = Loft(Options={Adjust=False, Closed=False, LoftEnds=0, LoftSimp=0, LoftType=0, Rebuild=10, Refit=0.01})

# ----
# PROBING
number_slider_11 = Slider(0.9, range=0..10)
settings_custom = SettingsCustom(
    StitchSeams=True,
    SimplePlanes=False,
    Refine=True,
    MinCount=16,
    MaxCount=400,
    AspectRatio=20,
    MaxDistance=0,
    MaxAngle=20,
    MinEdge=number_slider_11,
    MaxEdge=number_slider_11)
brep_5 = Brep(urbabmicroclimatefoam_case.DomainBox)
deconstruct_brep_2 = DeconstructBrep(Brep=brep_5)  # -> Faces, Edges, Vertices
list_item_4 = ListItem(List=deconstruct_brep_2.Faces, Index=4, Wrap=True)
unit_z = UnitZ(Factor=Slider(2.1, range=0..10))
mesh_brep_3 = MeshBrep(Brep=list_item_4, Settings=settings_custom)
move = Move(Geometry=mesh_brep_3, Motion=unit_z)  # -> Geometry, Transform
deconstruct_mesh = DeconstructMesh(Mesh=move.Geometry)  # -> Vertices, Faces, Colours, Normals
panel_8 = Panel("""U
T
w""")
number_slider_12 = Slider(1, range=0..10)
gradient = Gradient(
    LowerLimit=0,
    UpperLimit=number_slider_10,
    stops=[0: RGB(234, 38, 0), 0.25: RGB(234, 126, 0), 0.5: RGB(254, 244, 84), 0.75: RGB(173, 203, 249), 1: RGB(75, 107, 169)])

point = Point(deconstruct_mesh.Vertices)
point_in_breps = PointInBreps(Brep=brep_4, Point=point, Strict=False)  # -> Inside, Index
cull_vertices = CullVertices(Mesh=move.Geometry, Pattern=point_in_breps.Inside, Shrink=True)
deconstruct_mesh_2 = DeconstructMesh(Mesh=cull_vertices)  # -> Vertices, Faces, Colours, Normals

probing = Probing(
    Run=Button(),
    Simulator=case_run.Case,
    ProbingName="probe01",
    InterpolationScheme="2",
    Fields=panel_8,
    ProbingPoints=deconstruct_mesh_2.Vertices)
get_probes = GetProbes(Simulator=probing, ProbingName="probe01", Field="U")  # -> TimeSteps, simplify(ProbeValues)
get_probes_2 = GetProbes(Simulator=probing, ProbingName="probe01", Field="T")  # -> TimeSteps, simplify(ProbeValues)
get_probes_3 = GetProbes(Simulator=probing, ProbingName="probe01", Field="w")  # -> TimeSteps, simplify(ProbeValues)
tree_branch = TreeBranch(Tree=get_probes.ProbeValues, Path=Slider(1, range=0..10), MaintainPaths=False)
tree_branch_2 = TreeBranch(Tree=get_probes_2.ProbeValues, Path=number_slider_12, MaintainPaths=False)
tree_branch_3 = TreeBranch(Tree=get_probes_3.ProbeValues, Path=number_slider_12, MaintainPaths=False)
vector = Vector(tree_branch)
multiplication_2 = Multiplication(A=vector, B=Slider(0.26, range=0..1))
larger_than = LargerThan(FirstNumber=tree_branch_2, SecondNumber=1000000)  # -> LargerThan, OrEqualTo
larger_than_2 = LargerThan(FirstNumber=tree_branch_3, SecondNumber=1000000)  # -> LargerThan, OrEqualTo
larger_than_3 = LargerThan(FirstNumber=multiplication_2, SecondNumber=1000000)  # -> LargerThan, OrEqualTo
cull_pattern = CullPattern(List=multiplication_2, CullPattern=invert(larger_than_3.LargerThan))
cull_vertices_2 = CullVertices(Mesh=cull_vertices, Pattern=larger_than_3.LargerThan, Shrink=True)
cull_vertices_3 = CullVertices(Mesh=cull_vertices, Pattern=larger_than.LargerThan, Shrink=True)
cull_pattern_2 = CullPattern(List=tree_branch_2, CullPattern=invert(larger_than.LargerThan))
cull_vertices_4 = CullVertices(Mesh=cull_vertices, Pattern=larger_than_2.LargerThan, Shrink=True)
cull_pattern_3 = CullPattern(List=tree_branch_3, CullPattern=invert(larger_than_2.LargerThan))
bounds = Bounds(Numbers=cull_pattern)
deconstruct_mesh_3 = DeconstructMesh(Mesh=cull_vertices_2)  # -> Vertices, Faces, Colours, Normals
deconstruct_mesh_4 = DeconstructMesh(Mesh=cull_vertices_3)  # -> Vertices, Faces, Colours, Normals
bounds_2 = Bounds(Numbers=cull_pattern_2)
deconstruct_mesh_5 = DeconstructMesh(Mesh=cull_vertices_4)  # -> Vertices, Faces, Colours, Normals
bounds_3 = Bounds(Numbers=cull_pattern_3)
deconstruct_domain = DeconstructDomain(Domain=bounds)  # -> Start, End
deconstruct_domain_2 = DeconstructDomain(Domain=bounds_2)  # -> Start, End
deconstruct_domain_3 = DeconstructDomain(Domain=bounds_3)  # -> Start, End
amplitude = Amplitude(Vector=multiplication_2, Amplitude=1)
gradient_2 = Gradient(
    LowerLimit=deconstruct_domain.End,
    UpperLimit=deconstruct_domain.Start,
    Parameter=cull_pattern,
    stops=[0: RGB(234, 38, 0), 0.25: RGB(234, 126, 0), 0.5: RGB(254, 244, 84), 0.75: RGB(173, 203, 249), 1: RGB(75, 107, 169)])
vector_display_ex = VectorDisplayEx(Point=deconstruct_mesh_3.Vertices, Vector=cull_pattern, Colour=gradient_2, Width=2)

panel_9 = Panel(get_probes_2.TimeSteps)
panel_10 = Panel(deconstruct_domain_2.End)
gradient_3 = Gradient(
    LowerLimit=number_slider_10,
    UpperLimit=Slider(305, range=0..1000),
    Parameter=cull_pattern_2,
    stops=[0: RGB(49, 128, 171), 0.0924: RGB(76, 108, 169), 0.182: RGB(111, 144, 198), 0.274: RGB(159, 190, 238), 0.366: RGB(186, 208, 219), 0.458: RGB(224, 229, 145), 0.549: RGB(249, 235, 88), 0.642: RGB(247, 201, 53), 0.729: RGB(238, 146, 15), 0.824: RGB(234, 113, 0), 0.911: RGB(234, 70, 0), 1: RGB(216, 21, 0)])
text_tag_3d = TextTag3D(Location=deconstruct_mesh_4.Vertices, Text=cull_pattern_2, Size=Slider(0.11, range=0..1), Justification=5)

construct_mesh = ConstructMesh(Vertices=deconstruct_mesh_4.Vertices, Faces=deconstruct_mesh_4.Faces, Colours=gradient_3)

preview = CustomPreview(Material=gradient_3)
panel_11 = Panel(cull_pattern_3)
panel_12 = Panel(cull_pattern)
panel_13 = Panel(cull_pattern_2)
vector_length = VectorLength(Vector=panel_12)
kelvin2celsius = Python3Script(x=panel_13)  # -> out, a; inputs x: Double
# ---------- kelvin2celsius: Python ----------
"""Grasshopper Script"""
a = "Hello Python 3 in Grasshopper!"



def Kelvin2Celcius(Kelvin):
    return Kelvin - 273.15


a = Kelvin2Celcius(x)
# ---------- end kelvin2celsius ----------
utci_2 = UTCI(
    AmbientTemperature=kelvin2celsius.a,
    MeanRadiantTemperature=kelvin2celsius.a,
    WindVelocity=vector_length,
    RelativeHumidity=panel_11)
panel_14 = Panel(utci_2)
